# Grasshopper definition 模具.gh (Grasshopper 1.0.8)

py3 = Python3Script()  # -> out, MainBody, BackingLayer, AirNetwork, MainMold, BackingMold, Info
# ---------- py3: Python ----------
"""Rhino 8 Grasshopper - Python 3 Script component

Inputs (all Item Access):
    Run, L, WBase, WTip, BodyH, BackingH, ChamberH,
    ChamberLen, Pitch, SideWall, EndWall, ManifoldW,
    MoldClear, MoldFloor, MainMoldX, BackingMoldX

Outputs:
    MainBody, BackingLayer, AirNetwork, MainMold, BackingMold, Info
"""

import math
import Rhino.Geometry as rg


# Use these values when an input is unconnected or None.
DEFAULTS = {
    "Run": True,
    "L": 160.0,
    "WBase": 80.0,
    "WTip": 18.0,
    "BodyH": 10.0,
    "BackingH": 3.0,
    "ChamberH": 7.0,
    "ChamberLen": 4.0,
    "Pitch": 7.0,
    "SideWall": 5.0,
    "EndWall": 7.0,
    "ManifoldW": 3.0,
    "MoldClear": 8.0,
    "MoldFloor": 4.0,
    "MainMoldX": 120.0,
    "BackingMoldX": 240.0,
}


def value_or_default(value, name):
    return DEFAULTS[name] if value is None else value


Run = value_or_default(Run, "Run")
L = float(value_or_default(L, "L"))
WBase = float(value_or_default(WBase, "WBase"))
WTip = float(value_or_default(WTip, "WTip"))
BodyH = float(value_or_default(BodyH, "BodyH"))
BackingH = float(value_or_default(BackingH, "BackingH"))
ChamberH = float(value_or_default(ChamberH, "ChamberH"))
ChamberLen = float(value_or_default(ChamberLen, "ChamberLen"))
Pitch = float(value_or_default(Pitch, "Pitch"))
SideWall = float(value_or_default(SideWall, "SideWall"))
EndWall = float(value_or_default(EndWall, "EndWall"))
ManifoldW = float(value_or_default(ManifoldW, "ManifoldW"))
MoldClear = float(value_or_default(MoldClear, "MoldClear"))
MoldFloor = float(value_or_default(MoldFloor, "MoldFloor"))
MainMoldX = float(value_or_default(MainMoldX, "MainMoldX"))
BackingMoldX = float(value_or_default(BackingMoldX, "BackingMoldX"))

TOL = 0.01
BaseRadius = 6.0
TipRadius = WTip * 0.5


def join_curves(curves):
    joined = rg.Curve.JoinCurves(curves, TOL)
    if not joined or len(joined) != 1:
        raise Exception("无法生成单一闭合曲线。")
    curve = joined[0]
    if not curve.IsClosed:
        curve.MakeClosed(TOL)
    return curve


def tapered_outline():
    """Rounded tapered outline in World XY."""
    hb = WBase * 0.5
    ht = WTip * 0.5
    k = 0.7071067811865476

    p0 = rg.Point3d(-hb + BaseRadius, 0, 0)
    p1 = rg.Point3d(hb - BaseRadius, 0, 0)
    p2 = rg.Point3d(hb, BaseRadius, 0)
    p3 = rg.Point3d(ht, L - TipRadius, 0)
    p4 = rg.Point3d(-ht, L - TipRadius, 0)
    p5 = rg.Point3d(-hb, BaseRadius, 0)

    right_mid = rg.Point3d(
        hb - BaseRadius + BaseRadius * k,
        BaseRadius - BaseRadius * k,
        0,
    )
    left_mid = rg.Point3d(
        -hb + BaseRadius - BaseRadius * k,
        BaseRadius - BaseRadius * k,
        0,
    )

    return join_curves([
        rg.LineCurve(p0, p1),
        rg.ArcCurve(rg.Arc(p1, right_mid, p2)),
        rg.LineCurve(p2, p3),
        rg.ArcCurve(rg.Arc(p3, rg.Point3d(0, L, 0), p4)),
        rg.LineCurve(p4, p5),
        rg.ArcCurve(rg.Arc(p5, left_mid, p0)),
    ])


def half_width(y):
    """Half width of the tapered outline at a Y position."""
    hb = WBase * 0.5
    ht = WTip * 0.5
    y0 = BaseRadius
    y1 = L - TipRadius

    if y <= y0:
        return hb
    if y >= y1:
        dy = min(abs(y - y1), TipRadius)
        return math.sqrt(max(TipRadius * TipRadius - dy * dy, 0))

    t = (y - y0) / (y1 - y0)
    return hb + (ht - hb) * t


def capsule(x1, x2, y, length_y):
    """Horizontal capsule curve with rounded X ends."""
    r = length_y * 0.5
    if x2 - x1 <= length_y + TOL:
        r = max((x2 - x1) * 0.25, 0.25)

    bl = rg.Point3d(x1 + r, y - r, 0)
    br = rg.Point3d(x2 - r, y - r, 0)
    rt = rg.Point3d(x2 - r, y + r, 0)
    lt = rg.Point3d(x1 + r, y + r, 0)

    return join_curves([
        rg.LineCurve(bl, br),
        rg.ArcCurve(rg.Arc(br, rg.Point3d(x2, y, 0), rt)),
        rg.LineCurve(rt, lt),
        rg.ArcCurve(rg.Arc(lt, rg.Point3d(x1, y, 0), bl)),
    ])


def rectangle(x1, y1, x2, y2):
    return rg.PolylineCurve([
        rg.Point3d(x1, y1, 0),
        rg.Point3d(x2, y1, 0),
        rg.Point3d(x2, y2, 0),
        rg.Point3d(x1, y2, 0),
        rg.Point3d(x1, y1, 0),
    ])


def extrude(curve, z0, height):
    c = curve.DuplicateCurve()
    c.Transform(rg.Transform.Translation(0, 0, z0))
    extrusion = rg.Extrusion.Create(c, height, True)
    if extrusion is None:
        raise Exception("挤出失败。")
    return extrusion.ToBrep()


def box_brep(x1, y1, z1, x2, y2, z2):
    return rg.Box(
        rg.Plane.WorldXY,
        rg.Interval(x1, x2),
        rg.Interval(y1, y2),
        rg.Interval(z1, z2),
    ).ToBrep()


def union_all(breps):
    result = rg.Brep.CreateBooleanUnion(breps, TOL)
    return list(result) if result else []


def difference(source, cutters):
    result = rg.Brep.CreateBooleanDifference([source], cutters, TOL)
    if result:
        return list(result)

    # More robust fallback: subtract one object at a time.
    current = [source]
    for cutter in cutters:
        step = rg.Brep.CreateBooleanDifference(current, [cutter], TOL)
        if step:
            current = list(step)
    return current


def move_copy(brep, x):
    copy = brep.DuplicateBrep()
    copy.Transform(rg.Transform.Translation(x, 0, 0))
    return copy


def air_network():
    centers = []
    y = EndWall + ChamberLen * 0.5
    max_y = L - EndWall - ChamberLen * 0.5
    while y <= max_y + TOL:
        centers.append(y)
        y += Pitch

    pieces = []
    minimum_width = 1.0e9
    for cy in centers:
        hw = max(
            half_width(cy) - SideWall,
            ManifoldW * 0.5 + 1.0,
        )
        minimum_width = min(minimum_width, hw * 2.0)
        curve = capsule(-hw, hw, cy, ChamberLen)
        # Start slightly below Z=0 so mold cores union reliably with the floor.
        pieces.append(extrude(curve, -0.1, ChamberH + 0.1))

    manifold_end = centers[-1] + ChamberLen * 0.5
    manifold_curve = rectangle(
        -ManifoldW * 0.5,
        -0.8,
        ManifoldW * 0.5,
        manifold_end,
    )
    pieces.append(extrude(manifold_curve, -0.1, ChamberH + 0.1))

    joined = union_all(pieces)
    return (joined if len(joined) == 1 else pieces,
            centers,
            minimum_width,
            len(joined) == 1)


MainBody = []
BackingLayer = []
AirNetwork = []
MainMold = []
BackingMold = []
Info = "Run = False"


if Run:
    if ChamberH >= BodyH:
        raise Exception("ChamberH 必须小于 BodyH，顶部需要保留硅胶厚度。")
    if Pitch <= ChamberLen:
        raise Exception("Pitch 必须大于 ChamberLen，否则气室之间没有隔墙。")
    if WTip <= 2.0 * SideWall + ManifoldW:
        raise Exception("WTip 太窄；请减小 SideWall/ManifoldW 或增大 WTip。")

    outline = tapered_outline()
    outer_body = extrude(outline, 0, BodyH)
    network, centers, min_width, network_union_ok = air_network()

    MainBody = difference(outer_body, network)
    BackingLayer = [extrude(outline, -BackingH, BackingH)]
    AirNetwork = network

    mold_half_width = WBase * 0.5 + MoldClear
    mold_y1 = -MoldClear
    mold_y2 = L + MoldClear

    # Main-body open mold: cavity plus raised air-channel cores.
    main_block = box_brep(
        -mold_half_width, mold_y1, -MoldFloor,
        mold_half_width, mold_y2, BodyH,
    )
    main_cavity = extrude(outline, 0, BodyH + 1.0)
    main_tray = difference(main_block, [main_cavity])
    main_complete = union_all(main_tray + network)
    if not main_complete:
        main_complete = main_tray + network
    MainMold = [move_copy(b, MainMoldX) for b in main_complete]

    # 3 mm backing-layer open mold.
    backing_block = box_brep(
        -mold_half_width, mold_y1, -MoldFloor,
        mold_half_width, mold_y2, BackingH,
    )
    backing_cavity = extrude(outline, 0, BackingH + 1.0)
    backing_tray = difference(backing_block, [backing_cavity])
    BackingMold = [move_copy(b, BackingMoldX) for b in backing_tray]

    closed = []
    for group in [MainBody, BackingLayer, AirNetwork, MainMold, BackingMold]:
        closed.extend([b.IsSolid for b in group if isinstance(b, rg.Brep)])

    Info = (
        "PneuNet generated\n"
        "Chambers: {0}\n"
        "Chamber length: {1:.2f} mm\n"
        "Pitch: {2:.2f} mm\n"
        "Wall between chambers: {3:.2f} mm\n"
        "Chamber height: {4:.2f} mm\n"
        "Top silicone: {5:.2f} mm\n"
        "Minimum transverse chamber width: {6:.2f} mm\n"
        "Network union: {7}\n"
        "All Breps closed: {8}"
    ).format(
        len(centers),
        ChamberLen,
        Pitch,
        Pitch - ChamberLen,
        ChamberH,
        BodyH - ChamberH,
        min_width,
        network_union_ok,
        all(closed),
    )
# ---------- end py3 ----------
